vi "Rx_main.gvi"   [LabVIEW NXG]
panel controls:
  "IQ rate": f64 = 500000
  "carrier frequency": f64 = 2450000000
  "gain": f64 = 10
  "PSK type": enum{"normal", "shifted", "offset"} = "normal"
  "samples per symbol": i32 = 16
  "M-PSK": i32 = 4
  "modulation type": T1 = "PSK"
  "pulse shaping filter": T2 = "Root Raised Cos"
  "filter parameter": f64 = 0.5
  "stopFetchingLoop": bool
  "packet_size_with_padding": f64 = 10624
  "wanted_sync_index": f64 = 60
  "correction": f64 = 0.02
  "multiple": f64 = 10000
  "soundSamplesPerPacket": i32 = 128
  "bitsPerSample": i32 = 8
  "uLaw": bool
panel indicators:
  "Sync_Found?": bool
  "Sync_Index": f64
  "Demodulated IQ Graph": T3[]
  "SoundOutput": waveform<f64>[]
types:
  T1 = enum{"FSK", "PSK", "QAM", "MSK", "PAM", "ASK", "CPM"}
  T2 = enum{"none", "Raised Cosine", "Root Raised Cos", "Gaussian"}
  T3 = cluster{"constellation": f64[], "oversampled data": f64[]}
  T4 = cluster{"sample rate": f64, "number of channels": i32, "bits per sample": i32}
  T5 = cluster{"samples per symbol (16)": i32, "symbol map": c128[], "differential PSK": enum{"disable", "enable"}, "PSK type": enum{"normal", "shifted", "offset"}}
  T6 = cluster{"expected sync location (symbols)": i32, "sync sequence": c128[], "sync location uncertainty (symbols)": i32, "sync indent (symbols)": i32}
  T7 = cluster{"psk_system_params": T5, "pulse_shaping_filter_coeffs": f64[], "matched_filter_coeffs": f64[], "sync_params": T6, "sync_seq_bits": i8[]}
diagram:
  w1 = T4 {"sample rate"=6000, "number of channels"=1, "bits per sample"=8}
  w2 = $wanted_sync_index
  w3 = $packet_size_with_padding
  w4 = $soundSamplesPerPacket
  w5 = $bitsPerSample
  w6 = $correction
  w7 = $multiple
  call "initPSK.gvi"(PSK type=$"PSK type", samples per symbol=$"samples per symbol", M-PSK=$"M-PSK", modulation type=$"modulation type", pulse shaping filter=$"pulse shaping filter", filter parameter=$"filter parameter", PSK_params_in=T7 {all zero or empty}) -> (PSK_params_out=w8)
  call "Sound Output Configure.gvi"(device ID=0, sound format=w1, number of samples per channel=8000) -> (task ID=w9, error out=w10)
  call "Sound Output Start.gvi"(task ID=w9, error in=w10) -> (task ID out=w11, error out=w12)
  call "niUSRP Open Rx Session.gvi"(Device names="192.168.10.2") -> (Error Out=w13, Session handle=w14)
  call "niUSRP Configure Signal.gvi"(session handle=w14, IQ rate=$"IQ rate", carrier frequency=$"carrier frequency", gain=$gain, error in (no error)=w13, active antenna="RX1") -> (session handle out=w15, Error Out=w16)
  call "niUSRP Initiate.gvi"(session handle=w15, error in (no error)=w16) -> (session handle out=w17, Error Out=w18)
  w19 = cluster{"t0": f64, "dt": f64, "Y": c128[]} {all zero or empty}
  s1 = w19  # shift register
  s2 = uninitialised  # shift register
  s3 = uninitialised  # shift register
  while (iteration -> i1) {
    call "demodulation_block.gvi"(data=s1, PSK_params_in=w8) -> (output bit stream=w20, recovered complex waveform=w21, Sync_Found?=w22, sync found index=w23)
    Is Greater Than 0(x=i1) -> w24
    case (w24) {
      frame False, Default {
        w25 = w3
        w26 = w17
        w27 = w18
      }
      frame True {
        Not(x=w24) -> w28
        call "adjust_Samples_to_sync.gvi"(wanted_sync_index=w2, current_sync_index=w23, packet_size_with_padding=w3, first_interation?=w28, sync_location_last_iteration=s2, samples_last_interation=s3) -> (new_NumOfSamples=w25)
        w26 = w17
        w27 = w18
      }
    }
    To Unsigned Quad Integer(number=w25) -> w29
    call "niUSRP Fetch Rx Data (CDB Cluster).gvi"(session handle=w26, number of samples=w29, error in (no error)=w27) -> (session handle out=w30, data=w31, Error Out=w32)
    Multiply(w4, w5) -> w33
    call "extractDataBits.gvi"(appendedArray=w20, dataBitsPerPacket=w33) -> (dataArray=w34)
    call "soundBitStream2Integer.gvi"(bitStream=w34, numberOfSoundSamples=w4, bitsPerSample=w5) -> (integerArray=w35)
    case ($uLaw) {
      frame False, Default {
        To Double Precision Float(number=w35) -> w36
      }
      frame True {
        call "uLawDecodeArray8to16bits.gvi"(X=w35) -> (Y=w36)
      }
    }
    call "deShiftAndMultSoundArray.gvi"(unprocessedSoundArray=w36, correction=w6, multiple=w7) -> (processedArray=w37)
    Property Node(instance in=w1) -> ("sample rate"=w38)
    Reciprocal(x=w38) -> w39
    Build Waveform Node(Y=w37, dt=w39, t0=1904-01-01T00:00:00Z) -> (output waveform=w40)
    Build Array(w40, waveform<f64> {dt=1, Y=[]}) -> w41
    call "Sound Output Write.gvi"(task ID=w11, data=w41, error in=w12) -> (task ID out=w42, error out=w43)
    $"Sync_Found?" <- w22
    $Sync_Index <- w23
    $SoundOutput <- w41
    call "MT Format Constellation.gvi"(waveform=w21) -> (constellation graph=w44)
    $"Demodulated IQ Graph" <- w44
    next s1 = w31
    next s2 = w23
    next s3 = w25
    stop if $stopFetchingLoop
  }
  call "niUSRP Abort.gvi"(Handle in=w30, error in (no error)=w32) -> (Handle out=w45, Error Out=w46)
  call "niUSRP Close Session.gvi"(Handle in=w45, error in (no error)=w46)
  call "Sound Output Stop.gvi"(task ID=w42, error in=w43) -> (task ID out=w47, error out=w48)
  call "Sound Output Clear.gvi"(task ID=w47, error in=w48)
